# Grasshopper definition kinematicRoach_7-12_AHG.gh (Grasshopper 0.8.66)

tab_width = Slider(1, range=-2..2)
tab_hip_length = Slider(22, range=0..30)
hip_height = Slider(0.588, range=0..1)
hip_width = Slider(6.656, range=0..10)
h_space_b_w_hips = Slider(7.625, range=0..10)
upper_tab_width = Number(4.6875)
lower_tab_width = Number(upper_tab_width)
hip_height_2 = Number(5.9144)
hip_width_2 = Number(8.165)
num = Number(tab_hip_length)
pt = Point(Point(0, 0, 0))
panel = Panel("middle plate motion")
lolcat = RandomLolCat()
addition = Addition(A=num, B=h_space_b_w_hips)
multiplication = Multiplication(A=addition, B=2)
addition_2 = Addition(A=num, B=h_space_b_w_hips)
X = UnitX(Factor=multiplication)
X_2 = UnitX(Factor=addition_2)

# ----
# vector to rotating point
addition_3 = Addition(A=num, B=h_space_b_w_hips)
X_3 = UnitX(Factor=addition_3)

# ----
# pt for hinged tab
addition_4 = Addition(A=num, B=h_space_b_w_hips)
X_4 = UnitX(Factor=addition_4)
Y = UnitY(Factor=1)
panel_2 = Panel("bottom tab front")

# ----
# featuring:
# different tab widths for upper and lower tripods
# leg traces
# angle readouts
body_width = Slider(44, range=0..50)
crank = Slider(4, range=0..10)
Y_2 = UnitY(Factor=1)
circle = CircleCNR(Center=pt, Normal=Y_2, Radius=crank)
curvepoint = PointOnCurve(circle, parameter=1)

num_2 = Number(body_width)

Y_3 = UnitY(Factor=num_2)
move = Move(Geometry=curvepoint, Motion=Y_3)  # -> Geometry, Transform
ln = Line(StartPoint=curvepoint, EndPoint=move.Geometry)

# ----
# pt for hinged tab
addition_5 = Addition(A=num, B=h_space_b_w_hips)
multiplication_2 = Multiplication(A=addition_5, B=2)
Z = UnitZ(Factor=crank)
X_5 = UnitX(Factor=multiplication_2)
addition_6 = Addition(A=X_5, B=Z)
move_2 = Move(Geometry=curvepoint, Motion=X_5)  # -> Geometry, Transform

# ----
# pt for rigid tab
addition_7 = Addition(A=num, B=h_space_b_w_hips)
multiplication_3 = Multiplication(A=addition_7, B=2)
Z_2 = UnitZ(Factor=expr("-F", crank))
X_6 = UnitX(Factor=multiplication_3)
addition_8 = Addition(A=X_6, B=Z_2)
move_3 = Move(Geometry=pt, Motion=addition_8)  # -> Geometry, Transform

# ----
# pt for hinged tab
Z_3 = UnitZ(Factor=crank)
# pt for rigid tab
Y_4 = UnitY(Factor=num_2)
addition_9 = Addition(A=Y_4, B=Z_3)
# pt for rigid tab
Y_5 = UnitY(Factor=num_2)
move_4 = Move(Geometry=curvepoint, Motion=Y_4)  # -> Geometry, Transform

# ----
# vector to stationary point
addition_10 = Addition(A=num, B=h_space_b_w_hips)
X_7 = UnitX(Factor=addition_10)
Z_4 = UnitZ(Factor=crank)
addition_11 = Addition(A=Z_4, B=X_7)

# ----
# pt for hinged tab
Z_5 = UnitZ(Factor=crank)
move_5 = Move(Geometry=pt, Motion=addition_9)  # -> Geometry, Transform
# pt for rigid tab
Y_6 = UnitY(Factor=num_2)
Z_6 = UnitZ(Factor=expr("-F", crank))
addition_12 = Addition(A=Y_5, B=X)
addition_13 = Addition(A=Y_5, B=Z_5)
addition_14 = Addition(A=Y_6, B=X_2)
Z_7 = UnitZ(Factor=expr("-F", crank))
move_6 = Move(Geometry=curvepoint, Motion=addition_12)  # -> Geometry, Transform
addition_15 = Addition(A=addition_14, B=Z_6)
addition_16 = Addition(A=X, B=addition_13)

move_7 = Move(Geometry=curvepoint, Motion=X_3)  # -> Geometry, Transform
move_8 = Move(Geometry=pt, Motion=addition_11)  # -> Geometry, Transform

move_9 = Move(Geometry=pt, Motion=Z_7)  # -> Geometry, Transform
addition_17 = Addition(A=Y_6, B=X_4)
move_10 = Move(Geometry=pt, Motion=addition_15)  # -> Geometry, Transform
move_11 = Move(Geometry=pt, Motion=addition_16)  # -> Geometry, Transform
move_12 = Move(Geometry=curvepoint, Motion=addition_17)  # -> Geometry, Transform
line = LineSDL(Start=move_9.Geometry, Direction=expr("-D", Y), Length=lower_tab_width)
end = EndPoints(Curve=line)  # -> Start, End

X_8 = UnitX(Factor=1)
Z_8 = UnitZ(Factor=1)
Y_7 = UnitY(Factor=1)
Z_9 = UnitZ(Factor=1)
pl = Plane(Origin=end.End, XAxis=X_8, YAxis=Z_8)
pl_2 = Plane(Origin=curvepoint, XAxis=Y_7, YAxis=Z_9)
sph = Sphere(Base=pl, Radius=hip_height_2)
arc = Arc(Plane=pl_2, Radius=lower_tab_width, Angle=Domain(1.570796, 4.71238898))  # -> Arc, Length
panel_3 = Panel("fourbar side")
bcx = BrepCurve(Brep=sph, Curve=arc.Arc)  # -> Curves, Points
ln_2 = Line(StartPoint=curvepoint, EndPoint=bcx.Points)
item = ListItem(List=ln_2, Index=0, Wrap=False)
end_2 = EndPoints(Curve=item)  # -> Start, End
ln_3 = Line(StartPoint=end_2.End, EndPoint=end.End)

Z_10 = UnitZ(Factor=crank)

X_9 = UnitX(Factor=1)
X_10 = UnitX(Factor=1)
xprod = CrossProduct(VectorA=ln_3, VectorB=X_9, Unitize=False)  # -> Vector, Length
xprod_2 = CrossProduct(VectorA=ln_3, VectorB=X_10, Unitize=False)  # -> Vector, Length
line_2 = LineSDL(Start=end.End, Direction=xprod_2.Vector, Length=hip_width_2)
line_3 = LineSDL(Start=end_2.End, Direction=xprod.Vector, Length=hip_width_2)
end_3 = EndPoints(Curve=line_2)  # -> Start, End
end_4 = EndPoints(Curve=line_3)  # -> Start, End
ln_4 = Line(StartPoint=end_4.End, EndPoint=end_3.End)

end_5 = EndPoints(Curve=ln_4)  # -> Start, End
unit = UnitVector(Vector=ln_4)
panel_4 = Panel("lower leg")
move_13 = Move(Geometry=end_5.End, Motion=expr("T*22", unit))  # -> Geometry, Transform
ln_5 = Line(StartPoint=end_5.End, EndPoint=move_13.Geometry)
# for tracing leg movement
rec = DataRecorder(move_13.Geometry, RecordData=False, DataLimit=-10)

Z_11 = UnitZ(Factor=1)
xprod_3 = CrossProduct(VectorA=line_3, VectorB=expr("-B", Z_11), Unitize=True)  # -> Vector, Length
multiplication_4 = Multiplication(A=xprod_3.Vector, B=num)
line_4 = LineSDL(Start=[end_4.End, end_4.Start, end_3.End, end_3.Start], Direction=xprod_3.Vector, Length=num)
panel_5 = Panel("fourbar")
item_2 = ListItem(List=line_4, Index=3, Wrap=False)
move_14 = Move(Geometry=[line_3, line_2, ln_3, ln_4, item], Motion=multiplication_4)  # -> Geometry, Transform
end_6 = EndPoints(Curve=item_2)  # -> Start, End
Y_8 = UnitY(Factor=1)
line_5 = LineSDL(Start=end_6.End, Direction=Y_8, Length=lower_tab_width)

panel_6 = Panel("upper leg")

Y_9 = UnitY(Factor=1)
panel_7 = Panel("rigid tab")
line_6 = LineSDL(Start=move_4.Geometry, Direction=expr("D", Y_9), Length=upper_tab_width)
end_7 = EndPoints(Curve=line_6)  # -> Start, End
panel_8 = Panel("hinged tab")
X_11 = UnitX(Factor=1)
X_12 = UnitX(Factor=1)

Y_10 = UnitY(Factor=1)
line_7 = LineSDL(Start=move_3.Geometry, Direction=expr("-D", Y_10), Length=lower_tab_width)
end_8 = EndPoints(Curve=line_7)  # -> Start, End
X_13 = UnitX(Factor=1)
X_14 = UnitX(Factor=1)

X_15 = UnitX(Factor=1)
Z_12 = UnitZ(Factor=1)
Y_11 = UnitY(Factor=1)
Z_13 = UnitZ(Factor=1)
pl_3 = Plane(Origin=end_8.End, XAxis=X_15, YAxis=Z_12)
pl_4 = Plane(Origin=move_2.Geometry, XAxis=Y_11, YAxis=Z_13)
sph_2 = Sphere(Base=pl_3, Radius=hip_height_2)
arc_2 = Arc(Plane=pl_4, Radius=lower_tab_width, Angle=Domain(1.570796, 4.71238898))  # -> Arc, Length
bcx_2 = BrepCurve(Brep=sph_2, Curve=arc_2.Arc)  # -> Curves, Points
ln_6 = Line(StartPoint=move_2.Geometry, EndPoint=bcx_2.Points)
item_3 = ListItem(List=ln_6, Index=0, Wrap=False)
end_9 = EndPoints(Curve=item_3)  # -> Start, End
ln_7 = Line(StartPoint=end_9.End, EndPoint=end_8.End)

xprod_4 = CrossProduct(VectorA=ln_7, VectorB=X_13, Unitize=False)  # -> Vector, Length
xprod_5 = CrossProduct(VectorA=ln_7, VectorB=X_14, Unitize=False)  # -> Vector, Length
line_8 = LineSDL(Start=end_8.End, Direction=xprod_5.Vector, Length=hip_width_2)
line_9 = LineSDL(Start=end_9.End, Direction=xprod_4.Vector, Length=hip_width_2)
end_10 = EndPoints(Curve=line_8)  # -> Start, End
end_11 = EndPoints(Curve=line_9)  # -> Start, End
ln_8 = Line(StartPoint=end_11.End, EndPoint=end_10.End)

Z_14 = UnitZ(Factor=1)
xprod_6 = CrossProduct(VectorA=line_9, VectorB=expr("-B", Z_14), Unitize=True)  # -> Vector, Length
multiplication_5 = Multiplication(A=xprod_6.Vector, B=num)
line_10 = LineSDL(Start=[end_11.End, end_11.Start, end_10.End, end_10.Start], Direction=xprod_6.Vector, Length=num)
item_4 = ListItem(List=line_10, Index=3, Wrap=False)
move_15 = Move(Geometry=[line_9, line_8, ln_7, ln_8, item_3], Motion=multiplication_5)  # -> Geometry, Transform
end_12 = EndPoints(Curve=item_4)  # -> Start, End
Y_12 = UnitY(Factor=1)
line_11 = LineSDL(Start=end_12.End, Direction=Y_12, Length=lower_tab_width)

move_16 = Move(Geometry=end_9.Start, Motion=multiplication_5)  # -> Geometry, Transform
ln_9 = Line(StartPoint=pt, EndPoint=move_16.Geometry)
X_16 = UnitX(Factor=ln_9)
plane = PlaneSrf(Plane=PlaneXY(0, 0, 0), XSize=X_16, YSize=num_2)
move_17 = Move(Geometry=plane, Motion=expr("-T", Z_10))  # -> Geometry, Transform
move_18 = Move(Geometry=plane, Motion=Z_10)  # -> Geometry, Transform

extr = Extrude(Base=ln_8, Direction=expr("-D", line_8))
item_5 = ListItem(List=line_10, Index=1, Wrap=False)
move_19 = Move(Geometry=extr, Motion=multiplication_5)  # -> Geometry, Transform
panel_13 = Panel("surfaces")
extr_2 = Extrude(Base=item_5, Direction=expr("-D", item_3))
extr_3 = Extrude(Base=[item_5, item_4], Direction=line_8)
extr_4 = Extrude(Base=line_11, Direction=expr("-D", item_4))

extr_5 = Extrude(Base=ln_4, Direction=expr("-D", line_2))
item_6 = ListItem(List=line_4, Index=1, Wrap=False)
move_20 = Move(Geometry=extr_5, Motion=multiplication_4)  # -> Geometry, Transform
extr_6 = Extrude(Base=ln, Direction=X_16)
extr_7 = Extrude(Base=item_6, Direction=expr("-D", item))
extr_8 = Extrude(Base=[item_6, item_2], Direction=line_2)
extr_9 = Extrude(Base=line_5, Direction=expr("-D", item_2))

Y_13 = UnitY(Factor=1)
line_12 = LineSDL(Start=move_7.Geometry, Direction=expr("-D", Y_13), Length=upper_tab_width)
end_13 = EndPoints(Curve=line_12)  # -> Start, End
X_17 = UnitX(Factor=1)
X_18 = UnitX(Factor=1)

X_19 = UnitX(Factor=1)
Z_15 = UnitZ(Factor=1)
Y_14 = UnitY(Factor=1)
Z_16 = UnitZ(Factor=1)
pl_5 = Plane(Origin=end_13.End, XAxis=X_19, YAxis=Z_15)
pl_6 = Plane(Origin=move_8.Geometry, XAxis=Y_14, YAxis=Z_16)
sph_3 = Sphere(Base=pl_5, Radius=hip_height_2)
arc_3 = Arc(Plane=pl_6, Radius=upper_tab_width, Angle=Domain(1.570796, 4.71238898))  # -> Arc, Length
bcx_3 = BrepCurve(Brep=sph_3, Curve=arc_3.Arc)  # -> Curves, Points
ln_10 = Line(StartPoint=move_8.Geometry, EndPoint=bcx_3.Points)
item_7 = ListItem(List=ln_10, Index=0, Wrap=False)
end_14 = EndPoints(Curve=item_7)  # -> Start, End
ln_11 = Line(StartPoint=end_14.End, EndPoint=end_13.End)

xprod_7 = CrossProduct(VectorA=ln_11, VectorB=X_17, Unitize=False)  # -> Vector, Length
xprod_8 = CrossProduct(VectorA=ln_11, VectorB=X_18, Unitize=False)  # -> Vector, Length
line_13 = LineSDL(Start=end_13.End, Direction=xprod_8.Vector, Length=hip_width_2)
line_14 = LineSDL(Start=end_14.End, Direction=xprod_7.Vector, Length=hip_width_2)
end_15 = EndPoints(Curve=line_13)  # -> Start, End
end_16 = EndPoints(Curve=line_14)  # -> Start, End
ln_12 = Line(StartPoint=end_16.End, EndPoint=end_15.End)

Z_17 = UnitZ(Factor=1)
xprod_9 = CrossProduct(VectorA=line_14, VectorB=expr("-B", Z_17), Unitize=True)  # -> Vector, Length
multiplication_6 = Multiplication(A=xprod_9.Vector, B=num)
line_15 = LineSDL(Start=[end_16.End, end_16.Start, end_15.End, end_15.Start], Direction=xprod_9.Vector, Length=num)
item_8 = ListItem(List=line_15, Index=3, Wrap=False)
move_21 = Move(Geometry=[line_14, line_13, ln_11, ln_12, item_7], Motion=multiplication_6)  # -> Geometry, Transform
end_17 = EndPoints(Curve=item_8)  # -> Start, End
Y_15 = UnitY(Factor=1)
line_16 = LineSDL(Start=end_17.End, Direction=Y_15, Length=lower_tab_width)

extr_10 = Extrude(Base=ln_12, Direction=expr("-D", line_13))
item_9 = ListItem(List=line_15, Index=1, Wrap=False)
move_22 = Move(Geometry=extr_10, Motion=multiplication_6)  # -> Geometry, Transform
extr_11 = Extrude(Base=item_9, Direction=expr("-D", item_7))
extr_12 = Extrude(Base=[item_9, item_8], Direction=line_13)
extr_13 = Extrude(Base=line_16, Direction=expr("-D", item_8))

Y_16 = UnitY(Factor=1)
line_17 = LineSDL(Start=move_10.Geometry, Direction=expr("D", Y_16), Length=lower_tab_width)
end_18 = EndPoints(Curve=line_17)  # -> Start, End
X_20 = UnitX(Factor=1)
X_21 = UnitX(Factor=1)

X_22 = UnitX(Factor=1)
Z_18 = UnitZ(Factor=1)
Y_17 = UnitY(Factor=1)
Z_19 = UnitZ(Factor=1)
pl_7 = Plane(Origin=end_7.End, XAxis=X_22, YAxis=Z_18)
pl_8 = Plane(Origin=move_5.Geometry, XAxis=Y_17, YAxis=Z_19)
sph_4 = Sphere(Base=pl_7, Radius=hip_height_2)
arc_4 = Arc(Plane=pl_8, Radius=upper_tab_width, Angle=Domain(-1.570796327, 1.570796327))  # -> Arc, Length
bcx_4 = BrepCurve(Brep=sph_4, Curve=arc_4.Arc)  # -> Curves, Points
ln_13 = Line(StartPoint=move_5.Geometry, EndPoint=bcx_4.Points)

rev = ReverseList(List=ln_13)

item_10 = ListItem(List=rev, Index=0, Wrap=False)
end_19 = EndPoints(Curve=item_10)  # -> Start, End
ln_14 = Line(StartPoint=end_19.End, EndPoint=end_7.End)

xprod_10 = CrossProduct(VectorA=ln_14, VectorB=X_11, Unitize=False)  # -> Vector, Length
xprod_11 = CrossProduct(VectorA=ln_14, VectorB=X_12, Unitize=False)  # -> Vector, Length
line_18 = LineSDL(Start=end_7.End, Direction=expr("-D", xprod_11.Vector), Length=hip_width_2)
line_19 = LineSDL(Start=end_19.End, Direction=expr("-D", xprod_10.Vector), Length=hip_width_2)
end_20 = EndPoints(Curve=line_18)  # -> Start, End
end_21 = EndPoints(Curve=line_19)  # -> Start, End
ln_15 = Line(StartPoint=end_21.End, EndPoint=end_20.End)

end_22 = EndPoints(Curve=ln_15)  # -> Start, End
unit_2 = UnitVector(Vector=ln_15)
move_23 = Move(Geometry=end_22.End, Motion=expr("T*22", unit_2))  # -> Geometry, Transform
ln_16 = Line(StartPoint=end_22.End, EndPoint=move_23.Geometry)
rec_2 = DataRecorder(move_23.Geometry, RecordData=False, DataLimit=-10)

Z_20 = UnitZ(Factor=1)
xprod_12 = CrossProduct(VectorA=line_19, VectorB=expr("-B", Z_20), Unitize=True)  # -> Vector, Length
line_20 = LineSDL(Start=[end_21.End, end_21.Start, end_20.End, end_20.Start], Direction=expr("-D", xprod_12.Vector), Length=num)
multiplication_7 = Multiplication(A=xprod_12.Vector, B=num)
move_24 = Move(Geometry=[line_19, line_18, ln_14, ln_15, item_10], Motion=expr("-T", multiplication_7))  # -> Geometry, Transform
item_11 = ListItem(List=line_20, Index=3, Wrap=False)
end_23 = EndPoints(Curve=item_11)  # -> Start, End
Y_18 = UnitY(Factor=1)
line_21 = LineSDL(Start=end_23.End, Direction=expr("-D", Y_18), Length=lower_tab_width)

extr_14 = Extrude(Base=ln_15, Direction=expr("-D", line_18))
item_12 = ListItem(List=line_20, Index=1, Wrap=False)
move_25 = Move(Geometry=extr_14, Motion=expr("-T", multiplication_7))  # -> Geometry, Transform
extr_15 = Extrude(Base=item_12, Direction=expr("-D", item_10))
extr_16 = Extrude(Base=[item_12, item_11], Direction=line_18)
extr_17 = Extrude(Base=line_21, Direction=expr("-D", item_11))

Y_19 = UnitY(Factor=1)
line_22 = LineSDL(Start=move_6.Geometry, Direction=expr("D", Y_19), Length=upper_tab_width)
end_24 = EndPoints(Curve=line_22)  # -> Start, End
X_23 = UnitX(Factor=1)
X_24 = UnitX(Factor=1)

X_25 = UnitX(Factor=1)
Z_21 = UnitZ(Factor=1)
Y_20 = UnitY(Factor=1)
Z_22 = UnitZ(Factor=1)
pl_9 = Plane(Origin=end_18.End, XAxis=X_25, YAxis=Z_21)
pl_10 = Plane(Origin=move_12.Geometry, XAxis=Y_20, YAxis=Z_22)
sph_5 = Sphere(Base=pl_9, Radius=hip_height_2)
arc_5 = Arc(Plane=pl_10, Radius=lower_tab_width, Angle=Domain(-1.570796, 1.570796327))  # -> Arc, Length
bcx_5 = BrepCurve(Brep=sph_5, Curve=arc_5.Arc)  # -> Curves, Points
ln_17 = Line(StartPoint=move_12.Geometry, EndPoint=bcx_5.Points)

rev_2 = ReverseList(List=ln_17)

item_13 = ListItem(List=rev_2, Index=0, Wrap=False)
end_25 = EndPoints(Curve=item_13)  # -> Start, End
ln_18 = Line(StartPoint=end_25.End, EndPoint=end_18.End)

xprod_13 = CrossProduct(VectorA=ln_18, VectorB=X_20, Unitize=False)  # -> Vector, Length
xprod_14 = CrossProduct(VectorA=ln_18, VectorB=X_21, Unitize=False)  # -> Vector, Length
line_23 = LineSDL(Start=end_18.End, Direction=expr("-D", xprod_14.Vector), Length=hip_width_2)
line_24 = LineSDL(Start=end_25.End, Direction=expr("-D", xprod_13.Vector), Length=hip_width_2)
end_26 = EndPoints(Curve=line_23)  # -> Start, End
end_27 = EndPoints(Curve=line_24)  # -> Start, End
ln_19 = Line(StartPoint=end_27.End, EndPoint=end_26.End)

xz = XZPlane(Origin=Point(0, 0, 0))
yz = YZPlane(Origin=Point(0, 0, 0))
Y_21 = UnitY(Factor=1)
Z_23 = UnitZ(Factor=1)
angle = Angle(VectorA=Y_21, VectorB=line_24, Plane=yz)  # -> Angle, Reflex
angle_2 = Angle(VectorA=Z_23, VectorB=ln_19, Plane=xz)  # -> Angle, Reflex
panel_28 = Panel("for measuring angle")
deg = Degrees(Radians=angle.Angle)
deg_2 = Degrees(Radians=angle_2.Angle)

# ----
# abduction angle (degrees)
# middle leg
panel_29 = Panel(angle.Angle)

# ----
# pro-/retraction angle (degrees)
# middle leg
panel_30 = Panel(deg_2)

Z_24 = UnitZ(Factor=1)
xprod_15 = CrossProduct(VectorA=line_24, VectorB=expr("-B", Z_24), Unitize=True)  # -> Vector, Length
line_25 = LineSDL(Start=[end_27.End, end_27.Start, end_26.End, end_26.Start], Direction=expr("-D", xprod_15.Vector), Length=num)
multiplication_8 = Multiplication(A=xprod_15.Vector, B=num)
move_26 = Move(Geometry=[line_24, line_23, ln_18, ln_19, item_13], Motion=expr("-T", multiplication_8))  # -> Geometry, Transform
item_14 = ListItem(List=line_25, Index=3, Wrap=False)
end_28 = EndPoints(Curve=item_14)  # -> Start, End
Y_22 = UnitY(Factor=1)
line_26 = LineSDL(Start=end_28.End, Direction=expr("-D", Y_22), Length=lower_tab_width)

extr_18 = Extrude(Base=ln_19, Direction=expr("-D", line_23))
item_15 = ListItem(List=line_25, Index=1, Wrap=False)
move_27 = Move(Geometry=extr_18, Motion=expr("-T", multiplication_8))  # -> Geometry, Transform
extr_19 = Extrude(Base=item_15, Direction=expr("-D", item_13))
extr_20 = Extrude(Base=[item_15, item_14], Direction=line_23)
extr_21 = Extrude(Base=line_26, Direction=expr("-D", item_14))

X_26 = UnitX(Factor=1)
Z_25 = UnitZ(Factor=1)
Y_23 = UnitY(Factor=1)
Z_26 = UnitZ(Factor=1)
pl_11 = Plane(Origin=end_24.End, XAxis=X_26, YAxis=Z_25)
pl_12 = Plane(Origin=move_11.Geometry, XAxis=Y_23, YAxis=Z_26)
sph_6 = Sphere(Base=pl_11, Radius=hip_height_2)
arc_6 = Arc(Plane=pl_12, Radius=upper_tab_width, Angle=Domain(-1.570796327, 1.570796327))  # -> Arc, Length
bcx_6 = BrepCurve(Brep=sph_6, Curve=arc_6.Arc)  # -> Curves, Points
ln_20 = Line(StartPoint=move_11.Geometry, EndPoint=bcx_6.Points)

rev_3 = ReverseList(List=ln_20)

item_16 = ListItem(List=rev_3, Index=0, Wrap=False)
end_29 = EndPoints(Curve=item_16)  # -> Start, End
ln_21 = Line(StartPoint=end_29.End, EndPoint=end_24.End)

xprod_16 = CrossProduct(VectorA=ln_21, VectorB=X_24, Unitize=False)  # -> Vector, Length
xprod_17 = CrossProduct(VectorA=ln_21, VectorB=X_23, Unitize=False)  # -> Vector, Length
line_27 = LineSDL(Start=end_24.End, Direction=expr("-D", xprod_16.Vector), Length=hip_width_2)
line_28 = LineSDL(Start=end_29.End, Direction=expr("-D", xprod_17.Vector), Length=hip_width_2)
end_30 = EndPoints(Curve=line_27)  # -> Start, End
end_31 = EndPoints(Curve=line_28)  # -> Start, End
ln_22 = Line(StartPoint=end_31.End, EndPoint=end_30.End)

xz_2 = XZPlane(Origin=Point(0, 0, 0))
yz_2 = YZPlane(Origin=Point(0, 0, 0))
Y_24 = UnitY(Factor=1)
Z_27 = UnitZ(Factor=1)
angle_3 = Angle(VectorA=Y_24, VectorB=line_28, Plane=yz_2)  # -> Angle, Reflex
angle_4 = Angle(VectorA=Z_27, VectorB=ln_22, Plane=xz_2)  # -> Angle, Reflex
deg_3 = Degrees(Radians=angle_3.Angle)
deg_4 = Degrees(Radians=angle_4.Angle)

# ----
# abduction angle (degrees)
# rear leg
panel_35 = Panel(angle_3.Angle)

# ----
# pro-/retraction angle (degrees)
# rear leg
panel_36 = Panel(deg_4)

Z_28 = UnitZ(Factor=1)
xprod_18 = CrossProduct(VectorA=line_28, VectorB=expr("-B", Z_28), Unitize=True)  # -> Vector, Length
line_29 = LineSDL(Start=[end_31.End, end_31.Start, end_30.End, end_30.Start], Direction=expr("-D", xprod_18.Vector), Length=num)
multiplication_9 = Multiplication(A=xprod_18.Vector, B=num)
move_28 = Move(Geometry=[line_28, line_27, ln_21, ln_22, item_16], Motion=expr("-T", multiplication_9))  # -> Geometry, Transform
item_17 = ListItem(List=line_29, Index=3, Wrap=False)
end_32 = EndPoints(Curve=item_17)  # -> Start, End
Y_25 = UnitY(Factor=1)
line_30 = LineSDL(Start=end_32.End, Direction=expr("-D", Y_25), Length=lower_tab_width)

extr_22 = Extrude(Base=ln_22, Direction=expr("-D", line_27))
item_18 = ListItem(List=line_29, Index=1, Wrap=False)
move_29 = Move(Geometry=extr_22, Motion=expr("-T", multiplication_9))  # -> Geometry, Transform
extr_23 = Extrude(Base=item_18, Direction=expr("-D", item_16))
extr_24 = Extrude(Base=[item_18, item_17], Direction=line_27)
extr_25 = Extrude(Base=line_30, Direction=expr("-D", item_17))
